# Grasshopper definition linetypes.gh (Grasshopper 1.0.7)

crv = Curve(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)
crv_2 = Curve(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)
crv_3 = Curve(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)
arrowcurve = GhPythonScript(curve=crv, scale=Slider(51, range=0..100))  # -> pattern
# ---------- arrowcurve: Python ----------
import rhinoscriptsyntax as rs
import scriptcontext as sc

def arrowCurve():
    """
    ---->---->---->---->---->---->---->----
    this script divides a curve by length and adds dashes to either side of the curve, grouped per curve / polyline
    limitation: does not accomodate at corners (to avoid ccx issues)
    www.studiogijs.nl
    """

    if not curve or not scale:
        return

    lines=[]
    if rs.CurveLength(curve)>scale:
        pts = rs.DivideCurveLength(curve, scale)
        for pt in pts:
            t=rs.CurveClosestPoint(curve, pt)
            vec = rs.CurveTangent(curve, t)*scale/10
            line = rs.AddLine(pt, pt+vec)
            line_copy = rs.CopyObject(line, [0,0,0])
            rs.RotateObject(line, pt, 45)
            rs.RotateObject(line_copy, pt, -45)
            lines.append(line)
            lines.append(line_copy)
    return lines
pattern = arrowCurve()
# ---------- end arrowcurve ----------
multiline = GhPythonScript(curve=crv_2, scale=Slider(49, range=0..100))  # -> pattern
# ---------- multiline: Python ----------
import rhinoscriptsyntax as rs
import scriptcontext as sc

def multiLineCurve():
    """
    --- --- --- --- --- --- --- --- --- --- ---
    -------------------------------------------
    --- --- --- --- --- --- --- --- --- --- --- 
    this script divides a curve by length and adds dashes to either side of the curve, grouped per curve / polyline
    limitation: does not accomodate at corners (to avoid ccx issues)
    www.studiogijs.nl
    """

    if not curve or not scale:
        return

    lines=[]
    if rs.CurveLength(curve)>scale:
        pts = rs.DivideCurveLength(curve, scale)
        for pt in pts:
            t=rs.CurveClosestPoint(curve, pt)
            vec = rs.CurveTangent(curve, t)*scale/5
            line = rs.AddLine(pt-vec, pt+vec)
            trans = rs.VectorRotate(vec, 90, [0,0,1])
            trans/=2
            line_copy = rs.CopyObject(line, trans)
            trans = -trans
            lines.append(line_copy)
            rs.MoveObject(line, trans)
            lines.append(line)
    return lines

                
pattern = multiLineCurve()
# ---------- end multiline ----------
fence = GhPythonScript(curve=crv_3, scale=Slider(53, range=0..100))  # -> pattern
# ---------- fence: Python ----------
import rhinoscriptsyntax as rs
import scriptcontext as sc
def fenceCurve():
    """
    ---x---x---x---x---x---x---
    this script divides a curve by length and adds 'crosses' to it, grouped per curve / polyline
    www.studiogijs.nl
    """
    
    if not curve or not scale:
        return

    lines=[]
    if rs.CurveLength(curve)>scale:
        pts = rs.DivideCurveLength(curve, scale)
        for pt in pts:
            t=rs.CurveClosestPoint(curve, pt)
            vec = rs.CurveTangent(curve, t)
            line = rs.AddLine(pt-vec*scale/10, pt+vec*scale/10)
            rs.RotateObject(line, pt, 45)
            lines.append(line)
            line_copy = rs.RotateObject(line, pt, 90, copy=True)
            lines.append(line_copy)
        
    return lines

pattern = fenceCurve()
# ---------- end fence ----------
